vi "UDPtest.gvi"   [LabVIEW Communications System Design Suite 2.0.1]
panel controls:
  "TestManConfig in": T1 = {"port"=50000, "ip"="224.5.6.7", "connection"=refnum, "type"=123, "id"=123}
  "stop": bool
  "UDP port GFDM": u16 = 50001
  "UDP port mmWave": u16 = 50005
  "Packet size": i32 = 1316
  "Panel": i32
panel indicators:
  "status": T2
  "paket": T2
  "command": string
  "switch channel message": T2
  "name of variable": string[]
  "content": string[]
  "channel": string
  "Current Channel": i32
  "GFDM UDP write": u8[]
  "UDP mmWave write": u8[]
  "UDP Video in read": u8[]
  "address": string
  "port": u16
  "error description": string  # source out indicates the source of the error.
  "while error description": string  # source out indicates the source of the error.
  "output array": u8[]
types:
  T1 = cluster{"port": u16, "ip": string, "connection": UdpNetworkConnectionRefnum, "type": u8, "id": u8}
  T2 = cluster{"type": u8, "id": u8, "name of variable": string[], "content": string[]}
diagram:
  disable {
    frame Enabled { }
    frame Disabled {
      # For mmWave instead of local host
    }
  }
  w1 = $"Packet size"
  Udp Open(port=49999) -> (connection ID=w2, error out=w3)
  Udp Open(port=49000) -> (connection ID=w4, error out=w5)
  Udp Open(port=49001) -> (connection ID=w6, error out=w7)
  Merge Errors(w3, w5, w7) -> (error out=w8)
  case (w8) {
    frame No Error, Default {
      while (iteration -> i1) {
        Udp Read I Pv 6 Binary(connection ID=w2, error in=w3, max size=w1, timeout ms=100) -> (address=w15, connection ID out=w13, data out=w16, error out=w14, port=w17)
        call "Display Error.gvi"(type of dialog="no dialog", error in=w14) -> (description=w18)
        $"error description" <- w18
        Wait[Units=Microseconds](time to wait=100)
        $"UDP Video in read" <- w16
        Is Equal(x="1", y=$channel)
        To Unsigned Word Integer(number=i1) -> w19
        Split Number(x=w19) -> (high(x)=w20, low(x)=w21)
        Build Array(w20, w21) -> w22
        Insert Into Array(inArray=w16, index0=0, new=w22) -> w23
        $"output array" <- w23
        $address <- w15
        Quotient And Remainder(x=i1, y=2) -> (x-y*floor(x/y)=w24)
        Is Equal To 0(x=w24) -> w25
        Array Size(array=w23) -> (size(s)=w26)
        Is Greater(x=w26, y=2) -> w27
        case (w27) {
          frame False, Default {
            w9 = w4
            w10 = w5
            w11 = w6
            w12 = w7
            w28 = w5
          }
          frame True {
            case (w25) {
              frame False, Default {
                $"GFDM UDP write" <- w23
                # GFDM
                Udp Write Binary(address="localhost", connection ID=w4, data in=w23, error in=w5, port or service name=$"UDP port GFDM", timeout ms=100) -> (connection ID out=w9, error out=w10)
                w11 = default
                w12 = default
                w28 = w10
              }
              frame True {
                $"UDP mmWave write" <- w23
                # mmWave
                Udp Write Binary(address="localhost", connection ID=w6, data in=w23, error in=w7, port or service name=$"UDP port mmWave", timeout ms=100) -> (connection ID out=w11, error out=w12)
                w9 = default
                w10 = default
                w28 = w12
              }
            }
          }
        }
        call "Filter Error Code.gvi"(code to clear=55, error in=w28) -> (error out=w29)
        call "Display Error.gvi"(type of dialog="no dialog", error in=w29) -> (description=w30)
        $"while error description" <- w30
        $port <- w17
        call "Filter Error Code.gvi"(code to clear=56, error in=w14) -> (error out=w31)
        Logical Or(w31, w29, $stop) -> w32
        stop if w32
      }
    }
    frame Error {
      w9 = w6
      w10 = w7
      w11 = w4
      w12 = w5
      w13 = w2
      w14 = w3
    }
  }
  Udp Close(connection ID=w13, error in=w14)
  Udp Close(connection ID=w11, error in=w12)
  Udp Close(connection ID=w9, error in=w10)
  call "UDPopen.gvi"(TestManConfig in=$"TestManConfig in") -> (TestManConfig out=w33, error out=w34)
  s1 = w34  # shift register
  while {
    Wait(time to wait=1)
    call "UDPdecode.gvi"(TestManConfig in=w33, Error in=s1) -> (Error out=w35, TestManConfig out=w36, timestamp out=w37, message out=w38, command out=w39, Packet received=w40)
    case (w40) {
      frame False, Default { }
      frame True {
        case (w39) ignore case {
          frame "" {
            $status <- w38
            w41 = default
          }
          frame Default {
            call "UDPreact.gvi"(TestManConfig in=w33, timestamp=w37, received?=FALSE)
            $paket <- w38
            $command <- w39
            w41 = default
          }
          frame "switch" {
            Property Node(instance in=w38) -> ("name of variable"=w42, "content"=w43)
            $"name of variable" <- w42
            $content <- w43
            $"switch channel message" <- w38
            Search 1D Array(1D array=w42, element="channel") -> (index of element=w44)
            Array Index(array=w43) -> (out0[w44]=w41)
            $channel <- w41
            Decimal String To Number(string=w41) -> (number=w45)
            $"Current Channel" <- w45
          }
        }
      }
    }
    Logical Or(w35, $stop) -> w46
    next s1 = w35
    stop if w46
  }
  call "UDPstop.gvi"(TestManConfig=w36, Error=s1)
  $stop <- FALSE
  s2 = w34  # shift register
  while {
    Wait(time to wait=1000)
    Tick Count() -> (timer value=w47)
    Number To Decimal String(number=w47) -> (decimal integer string=w48)
    Initialize Array(element=w48, size=1) -> w49
    w50 = T2 {"type"=0, "id"=0, "name of variable"=["ticks"], "content"=[]}
    Property Node(instance in=w50, "content"=w49) -> (instance out=w51)
    call "UDPsend.gvi"(TestManConfig in=w33, error in=s2, Message=w51) -> (error out=w52)
    Logical Or(w52, $stop) -> w53
    next s2 = w52
    stop if w53
  }
